vi "index.gviweb"   [LabVIEW NXG 5.0.0]
panel controls:
  "Button": bool
  "Button_2": bool
panel indicators:
  "LED": bool
  "Numeric": i32
  "LED_2": bool
  "LED_3": bool
  "LED_4": bool
  "LED_5": bool
  "LED_6": bool
diagram:
  # Place setup code before the loop. For example, perform initial data communication and wire the results into the loop.
  # Top-Level WebVIs usually contain a While Loop that never stops so that they can continue running as long as the web page is open in the user's web browser.
  s1 = 0  # shift register
  s2 = 0  # shift register
  while {
    $LED <- $Button
    Increment(x=s2) -> w1
    Is Greater Or Equal(x=w1, y=20) -> w2
    s3 = uninitialised  # shift register
    while {
      Not(x=s3) -> w3
      Logical And(w2, w3) -> w4
      next s3 = w2
      stop if TRUE
    }
    Increment(x=s1) -> w5
    Select(s=w4, t=w5, f=s1) -> w6
    Select(s=$Button_2, t=0, f=w6) -> w7
    $Numeric <- w7
    Number To Boolean Array(number=w7) -> (Boolean array=w8)
    Array Index(array=w8) -> (out0[0]=w9, out1[1]=w10, out2[2]=w11, out3[3]=w12, out4[4]=w13)
    $LED_2 <- w9
    $LED_3 <- w10
    $LED_4 <- w11
    $LED_5 <- w12
    $LED_6 <- w13
    Wait(time to wait=50)
    Select(s=w2, t=0, f=w1) -> w14
    next s1 = w7
    next s2 = w14
    stop if FALSE
  }
